# Dynamo graph Revit Model Health Report with .GetWarnings().dyn (Dynamo 2.0.3.8810)

views = Views()  # nothing selected
origin = Point.Origin()
now = DateTime.Now()

# group: Warnings
# note: Revit Model Health Report with .GetWarnings()
# Version 0.1
# Coded by Andrew King
# https://andrewkingme.com
# 2019-03-06 Version 0.1
# Hello World
python_script = Python()
# ---------- python_script.python (26 lines) ----------
# Python Node for Dynamo
# Get Warnings
# Coded by Andrew King
# https://andrewkingme.com

import clr

# Import RevitAPI
clr.AddReference('RevitAPI')
import Autodesk

# Import DocumentManager
clr.AddReference('RevitServices')
import RevitServices
from RevitServices.Persistence import DocumentManager

warnings = DocumentManager.Instance.CurrentDBDocument.GetWarnings()
descriptions = []
elements = []

for warning in warnings:
	descriptions.append(Autodesk.Revit.DB.FailureMessage.GetDescriptionText(warning))
	elements.append(Autodesk.Revit.DB.FailureMessage.GetFailingElements(warning))

#Assign your output to the OUT variable
OUT = warnings, descriptions, elements
# ----------------------------------------
transpose = List.Transpose(lists=python_script)
watch = Watch(transpose)

count = List.Count(list=watch)

# group: Imports
element_types = ElementTypes(index=160)
all_elements_of_type = ElementsOfType(element_type=element_types)
code_block = CodeBlock { "Shared Site"; }
parameterByName = Parameter.ParameterByName(element=all_elements_of_type, name=code_block)
isNull = Object.IsNull(obj=parameterByName)
filterByBoolMask = List.FilterByBoolMask(list=all_elements_of_type, mask=isNull)

count_2 = List.Count(list=filterByBoolMask.in)
count_3 = List.Count(list=filterByBoolMask.out)
code_block_2 = CodeBlock(dateTime=now, warnings=count, cadImports=count_2, cadLinks=count_3)
# ---------- code_block_2.designscript (6 lines) ----------
ToString(
"Report Date/Time: " + dateTime + "\n\n" +
warnings + " Warning(s)" + "\n" +
cadImports + " CAD Import(s)" + "\n" +
cadLinks + " CAD Link(s)"
);
# ----------------------------------------
select_horizontal_text_alignment = HorizontalAlignment(index=1)
byLocation = TextNote.ByLocation(view=views, location=origin, text=code_block_2, alignment=select_horizontal_text_alignment)
